% Simulink data dictionary DD_Mdl1.sldd

slBus1 = Simulink.Bus()
  wind_mpers: double
  GenSpd_radpers: double
  RotSpd_radpers: double
  ydotdot_mpers2: double
  xdotdot_mpers2: double
  zetadotdot_mpers2: double
  ThetaS_rad: double
  GenPwr_kW: double
  GenTq_Nm: double
  Pitch_rad: double

slBus2 = Simulink.Bus()
  RefBlPitch1: double
  RefBlPitch2: double
  RefBlPitch3: double
  RefGenTq: double

beta = [-0.03490659; -0.03141593; -0.02792527; -0.02443461; -0.02094395; -0.01745329; -0.01396263; -0.01047198; -0.006981317; -0.003490659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 0.4363323]

Ce = [17786.98 0 0 0 0
 0 1246331 0 0 0
 0 0 17128.2 0 0
 0 0 0 6215000 -6215000
 0 0 0 -6215000 6215000]

Cq = [0 0 0 0 0 0 0 0 0 0 0.003830672 0.00394819 0.004068218 0.004196959 0.0043344 0.004493687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
 0 0 0 0 0 0 0 0 0 0 0.003965853 0.004088964 0.004214591 0.004349716 0.004493895 0.00466437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
 0 0 0 0 0 0 0 0 0 0 0.00410095 0.004229266 0.004360711 0.004502222 0.004653085 0.004835962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
 0 0 0 0 0 0 0 0 0 0 0.004235974 0.004368751 0.004506044 0.004653899 0.004812006 0.005008237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
 0 0 0 0 0 0 0 0 0 0 0.004370257 0.004508168 0.004651207 0.004804546 0.004970619 0.005181045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
 0 0 0 0 0 0 0 0 0 0 0.004504064 0.004646597 0.00479601 0.004955092 0.005128834 0.005355202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
 0 0 0 0 0 0 0 0 0 0 0.004637931 0.004785042 0.00494046 0.005105252 0.005286377 0.005530113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
 0 0 0 0 0 0 0 0 0 0 0.004771556 0.004923465 0.00508408 0.005254849 0.005443876 0.005705921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
 0 0 0 0 0 0 0 0 0 0 0.004904341 0.005061235 0.005227312 0.005403758 0.00560163 0.005883486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
 0 0 0 0 0 0 0 0 0 0 0.005037046 0.005198197 0.005370089 0.005552046 0.005758675 0.00606166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 ]

Ct = [0 0 0 0 0 0 0 0 0 0 0.08361545 0.08668855 0.09000846 0.09340349 0.09686849 0.100566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
 0 0 0 0 0 0 0 0 0 0 0.08355772 0.08661666 0.08992033 0.09329398 0.09673536 0.1004209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
 0 0 0 0 0 0 0 0 0 0 0.08349865 0.08654233 0.08982766 0.09318067 0.09660152 0.100277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
 0 0 0 0 0 0 0 0 0 0 0.08343827 0.0864645 0.08973156 0.09306261 0.09646663 0.1001327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
 0 0 0 0 0 0 0 0 0 0 0.08337586 0.08638738 0.08963393 0.09294276 0.09632945 0.09998881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
 0 0 0 0 0 0 0 0 0 0 0.08330947 0.08637852 0.08953222 0.09282243 0.09619125 0.09988221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
 0 0 0 0 0 0 0 0 0 0 0.08324298 0.08629725 0.08942935 0.09270059 0.09605203 0.09973613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
 0 0 0 0 0 0 0 0 0 0 0.08317528 0.08621382 0.08932404 0.09257624 0.09591043 0.09959154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
 0 0 0 0 0 0 0 0 0 0 0.08310561 0.08612819 0.08921516 0.09244602 0.09576582 0.09943843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
 0 0 0 0 0 0 0 0 0 0 0.08303551 0.08603785 0.08910428 0.09231464 0.09561919 0.09929316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 ]

K5 = [1810494 0 0 0 -0
 0 5.734629e+08 0 0 -0
 0 0 1678867 0 -0
 0 0 0 867637000 -867637000
 0 0 0 -867637000 867637000]

lambda = [0; 0.1; 0.2; 0.3; 0.4; 0.5; 0.6; 0.7; 0.8; 0.9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 19.9]

M = [450170 628661.25 0 0 0
 628661.25 29704244.0625 0 0 0
 0 0 436865 0 0
 0 0 0 38759000 0
 0 0 0 0 5025497.444]

Q = [1 0 0; 47.25 0 0; 0 0.007407407 -0.7185185; 0 1 0; 0 0 -97]
rho = 1.225

wecs = struct(
  N=3,
  Ng=97,
  mh=56780,
  mbl=17740,
  mb=4435,
  mn=240000,
  mtower=347460,
  mr=110000,
  mt=436865,
  mtb=450170,
  H=90,
  Jg=534.116,
  Jr=38759000,
  wnb=4.393831,
  wnt=2.035752,
  wntsw=1.960354,
  zetat=0.01,
  zetab=0.00477465,
  Kt=1810494,
  Bt=17786.98,
  Ktsw=1678867,
  Btsw=17128.2,
  Kb=85621.02,
  Bb=186.0838,
  Ks=867637000,
  Bs=6215000,
  Rr=63,
  rb=47.25,
  etag=0.944)